# Grasshopper definition Tower.gh (Grasshopper 1.0.7)

pt = ConstructPoint(XCoordinate=0, YCoordinate=0, ZCoordinate=0)

ellipse = Ellipse(Plane=pt, Radius1=Slider(20, range=0..50), Radius2=Slider(30, range=0..50))  # -> Ellipse, Focus1, Focus2

floor_to_floor = Slider(11.4, range=0..20)
num_floors = Slider(14, range=0..20)
series = Series(Start=0, Step=floor_to_floor, Count=num_floors)
Z = UnitZ(Factor=series)
move = Move(Geometry=ellipse.Ellipse, Motion=Z)  # -> Geometry, Transform

series_2 = Series(Start=0, Step=Slider(28.857, range=0..30), Count=num_floors)
rad = Radians(Degrees=series_2)
rotate = Rotate(Geometry=move.Geometry, Angle=rad, Plane=PlaneXY(0, 0, 0))  # -> Geometry, Transform

number_slider = Slider(0.25, range=0..1)

Z_2 = UnitZ(Factor=floor_to_floor)
extr = Extrude(Base=rotate.Geometry, Direction=Z_2)
cap = CapHoles(Brep=extr)
