# Grasshopper definition XYZ-move-rhino-model.gh (Grasshopper 0.9.76)
# plug-ins: Firefly.Core

toggle = BooleanToggle(True)
number_slider = Slider(4, range=0..10)
timer = Timer(TimerInterval=100, Target=uno_read)
uno_read = UnoRead(StartReadingValues=toggle, PortNumber=number_slider)  # -> AnalogPin0, AnalogPin1, AnalogPin2, AnalogPin3, AnalogPin4, AnalogPin5, DigitalPin2, DigitalPin4, DigitalPin7, StatusMessage
open_port = OpenClosePort(OpenClosePort=toggle, PortNumber=number_slider, BaudRate=115200)
panel = Panel(uno_read.AnalogPin0)
panel_2 = Panel(uno_read.AnalogPin1)
analog_input = Panel("0 to 1023")
range = Panel("1 to 100")
analog_input_2 = Panel("0 to 1023")
range_2 = Panel("1 to 100")
panel_3 = Panel(uno_read.AnalogPin2)
analog_input_3 = Panel("0 to 1023")
range_3 = Panel("1 to 100")
remap = RemapNumbers(Value=panel, Source=analog_input, Target=range)  # -> Mapped, Clipped
remap_2 = RemapNumbers(Value=panel_2, Source=analog_input_2, Target=range_2)  # -> Mapped, Clipped
remap_3 = RemapNumbers(Value=panel_3, Source=analog_input_3, Target=range_3)  # -> Mapped, Clipped
int = Integer(remap.Mapped)
int_2 = Integer(remap_2.Mapped)
int_3 = Integer(remap_3.Mapped)
adj_output = Panel(int)
adj_output_2 = Panel(int_2)
adj_output_3 = Panel(int_3)
vec = VectorXYZ(XComponent=adj_output, YComponent=adj_output_2, ZComponent=adj_output_3)  # -> Vector, Length
geo = Geometry(<brep referenced from the Rhino model>)
move = Move(Geometry=geo, Motion=vec.Vector)  # -> Geometry, Transform
preview = CustomPreview(Geometry=move.Geometry, Shader=ColourSwatch(SwatchColor=RGB(56, 230, 255)))
