# Grasshopper definition intro-to-gh_tower_1.gh (Grasshopper 1.0.7)
# plug-ins: Firefly.Core

trigger = Trigger(Interval=50, TimerInterval=50, Target=uno_read)
ports_available = COMPortsAvailable()
toggle = BooleanToggle(True)
uno_read = UnoRead(StartReadingValues=toggle, PortNumber=ports_available)  # -> AnalogPin0, AnalogPin1, AnalogPin2, AnalogPin3, AnalogPin4, AnalogPin5, DigitalPin2, DigitalPin4, DigitalPin7, StatusMessage
remap = RemapNumbers(Value=uno_read.AnalogPin0, Source="0 to 1023", Target="0 to 30")  # -> Mapped, Clipped
open_port = OpenClosePort(OpenClosePort=toggle, PortNumber=ports_available, BaudRate="115200")
panel = Panel(open_port)
pt = ConstructPoint(XCoordinate=0, YCoordinate=uno_read.AnalogPin1, ZCoordinate=uno_read.AnalogPin2)

ellipse = Ellipse(Plane=pt, Radius1=Slider(20, range=0..50), Radius2=Slider(30, range=0..50))  # -> Ellipse, Focus1, Focus2

floor_to_floor = Slider(11.4, range=0..20)
num_floors = Slider(14, range=0..20)
series = Series(Start=0, Step=floor_to_floor, Count=num_floors)
Z = UnitZ(Factor=series)
move = Move(Geometry=ellipse.Ellipse, Motion=Z)  # -> Geometry, Transform

series_2 = Series(Start=0, Step=remap.Mapped, Count=num_floors)
rad = Radians(Degrees=series_2)
rotate = Rotate(Geometry=move.Geometry, Angle=rad, Plane=PlaneXY(0, 0, 0))  # -> Geometry, Transform

Z_2 = UnitZ(Factor=floor_to_floor)
extr = Extrude(Base=rotate.Geometry, Direction=Z_2)
cap = CapHoles(Brep=extr)
